# Grasshopper definition skyglazer final meshTESTINGv3.gh (Grasshopper 1.0.7)
# plug-ins: LunchBox, Pufferfish, LunchBoxML, Kangaroo2 Components

# ---- group: RH_IN:showBoundary
boolean_toggle = BooleanToggle(False)

# ---- group: RH_IN:showPeople
boolean_toggle_2 = BooleanToggle(False)

# ---- group: RH_IN:showTerrain
# LAYER OPTIONS
boolean_toggle_3 = BooleanToggle(False)

# ---- group: RH_IN:showTrees
boolean_toggle_4 = BooleanToggle(False)

# ----
# GROUPING
rh_in_showgroupnumbers = GetBoolean(Toggle(False), AtLeast=1, AtMost=1, FalseValue="False", TreeAccess=False, TrueValue="True")
rh_in_paneltypenumber = GetInteger(Slider(6, range=0..100), AtLeast=1, AtMost=1, Maximum=2147483647, Minimum=-2147483648, TreeAccess=False)
rh_in_panelgroupingtype = GetInteger(Slider(0, range=0..2), AtLeast=1, AtMost=1, Maximum=2147483647, Minimum=-2147483648, TreeAccess=False)

# ----
# COLOURING
rh_in_showcolour = GetBoolean(Toggle(True), AtLeast=1, AtMost=1, FalseValue="False", TreeAccess=False, TrueValue="True")
rh_in_colourtype = GetNumber(Slider(0, range=0..2), AtLeast=1, AtMost=1, Maximum=1.797693135e+308, Minimum=-1.797693135e+308, TreeAccess=False)

# ----
# PANELIZATION
rh_in_showwireframe = GetBoolean(Toggle(False), AtLeast=1, AtMost=1, FalseValue="False", TreeAccess=False, TrueValue="True")

rh_in_udivisions = GetNumber(Slider(36, range=0..100), AtLeast=1, AtMost=1, Maximum=1.797693135e+308, Minimum=-1.797693135e+308, TreeAccess=False)
rh_in_vdivisions = GetNumber(Slider(26, range=0..100), AtLeast=1, AtMost=1, Maximum=1.797693135e+308, Minimum=-1.797693135e+308, TreeAccess=False)
rh_in_paneltype = GetInteger(Slider(1, range=0..2), AtLeast=1, AtMost=1, Maximum=2147483647, Minimum=-2147483648, TreeAccess=False)

# ----
# GRIDSHELL
rh_in_showgridshellwireframe = GetBoolean(Toggle(False), AtLeast=1, AtMost=1, FalseValue="False", TreeAccess=False, TrueValue="True")
rh_in_showgridshell = GetBoolean(Toggle(False), AtLeast=1, AtMost=1, FalseValue="False", TreeAccess=False, TrueValue="True")
rh_in_gridangle = GetInteger(Slider(0, range=0..360), AtLeast=1, AtMost=1, Maximum=2147483647, Minimum=-2147483648, TreeAccess=False)
rh_in_gridsize = GetInteger(Slider(3, range=1..5), AtLeast=1, AtMost=1, Maximum=2147483647, Minimum=-2147483648, TreeAccess=False)

mesh = Mesh(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)

# ----
# FORM
rh_in_showoriginalmesh = GetBoolean(Toggle(True), AtLeast=1, AtMost=1, FalseValue="False", TreeAccess=False, TrueValue="True")
get_geometry = GetGeometry(mesh, AtLeast=1, AtMost=1, DeleteInput=False, Filter=1074004029, TreeAccess=False)

mesh_2 = Mesh(get_geometry)

# ---- group: create patch
mesh_3 = Mesh(get_geometry)
bbox = BoundingBox(Content=mesh_3, Plane=PlaneXY(0, 0, 0))  # -> Box, Box_2
debrep = DeconstructBrep(Brep=bbox.Box)  # -> Faces, Edges, Vertices
area = Area(Geometry=debrep.Faces)  # -> Area, Centroid
pdecon = Deconstruct(Point=area.Centroid)  # -> XComponent, YComponent, ZComponent
sort = SortList(Keys=pdecon.ZComponent, ValuesA=debrep.Faces)  # -> Keys, ValuesA
item = ListItem(List=sort.ValuesA, Index=0, Wrap=True)
debrep_2 = DeconstructBrep(Brep=item)  # -> Faces, Edges, Vertices
item_2 = ListItem(List=debrep_2.Edges, Index=0, Wrap=True)
divide = DivideCurve(Curve=item_2, Count=10, Kinks=False)  # -> reverse(Points), Tangents, Parameters
yz = YZPlane(Origin=divide.Points)
sec = MeshPlane(Mesh=get_geometry, Plane=yz)
crv = Curve(sec)
crv_2 = Curve(crv)
xy = XYPlane(Origin=Point(0, 0, 0))
pcx = CurvePlane(Curve=crv_2, Plane=xy)  # -> Points, ParamsC, ParamsP
shatter = Shatter(Curve=graft(crv_2), Parameters=pcx.ParamsC)
combine = CombineData(Input0=shatter, Input1=graft(crv_2))  # -> Result, Index
curvepoint = PointOnCurve(combine.Result, parameter=0.5)
pdecon_2 = Deconstruct(Point=curvepoint)  # -> XComponent, YComponent, ZComponent
larger = LargerThan(FirstNumber=pdecon_2.ZComponent, SecondNumber="0")  # -> LargerThan, OrEqualTo
dispatch = Dispatch(List=combine.Result, DispatchPattern=larger.LargerThan)  # -> ListA, ListB
crv_3 = Curve(dispatch.ListA)
xy_2 = XYPlane(Origin=Point(0, 0, 0))
Z = UnitZ(Factor=Slider(0.1, range=0..0.1))
move = Move(Geometry=xy_2, Motion=Z)  # -> Geometry, Transform
sec_2 = MeshPlane(Mesh=get_geometry, Plane=move.Geometry)
reb = RebuildCurve(Curve=sec_2, Degree="3", Count=Slider(34, range=0..100), Tangents=False)
rebcrv = RebuildCurve(Curve=crv_3, Count=Slider(4, range=0..10), Degree="3", EndTangents=False)
number_slider = Slider(50, range=0..100)
patch = Patch(Curves=flatten([reb, rebcrv]), Spans=Slider(50, range=0..100), Flexibility=1, Trim=False)
rebsrf = RebuildSurface(Surface=patch, DomainU=number_slider, DomainV=number_slider)

# ----
bbox_2 = BoundingBox(Content=mesh_2, Plane=PlaneXY(0, 0, 0))  # -> Box, Box_2
debrep_3 = DeconstructBrep(Brep=bbox_2.Box)  # -> Faces, Edges, Vertices
area_2 = Area(Geometry=debrep_3.Faces)  # -> Area, Centroid
pdecon_3 = Deconstruct(Point=area_2.Centroid)  # -> XComponent, YComponent, ZComponent
sort_2 = SortList(Keys=pdecon_3.ZComponent, ValuesA=debrep_3.Faces)  # -> Keys, ValuesA
custom_mesh_settings = SettingsCustom(
    StitchSeams=True,
    SimplePlanes=False,
    Refine=True,
    MinCount=16,
    MaxCount=400,
    AspectRatio=20,
    MaxDistance=0,
    MaxAngle=20,
    MinEdge=rh_in_gridsize,
    MaxEdge=rh_in_gridsize)
item_3 = ListItem(List=sort_2.ValuesA, Index=0, Wrap=True)
area_3 = Area(Geometry=item_3)  # -> Area, Centroid
scale = Scale(Geometry=item_3, Center=area_3.Centroid, Factor=Slider(2, range=0..10))  # -> Geometry, Transform
rotate = Rotate(Geometry=scale.Geometry, Angle=degrees(rh_in_gridangle), Plane=PlaneXY(0, 0, 0))  # -> Geometry, Transform
mesh_4 = Mesh(mesh_2)
Z_2 = UnitZ(Factor=Slider(22, range=0..100))
mesh_5 = MeshBrep(Brep=rotate.Geometry, Settings=custom_mesh_settings)
move_2 = Move(Geometry=mesh_5, Motion=Z_2)  # -> Geometry, Transform
warpweft = WarpWeft(Mesh=move_2.Geometry)  # -> Warp, Weft, NakedA, NakedB
crv_4 = Curve(warpweft.Weft)
crv_5 = Curve(warpweft.Warp)
demesh = DeconstructMesh(Mesh=move_2.Geometry)  # -> Vertices, Faces, Colours, Normals
join = JoinCurves(Curves=crv_4, Preserve=False)
join_2 = JoinCurves(Curves=crv_5, Preserve=False)
srf = Surface(rebsrf)
stream_gate = StreamGate(Stream=srf, Gate=rh_in_paneltype)  # -> Target0, Target1, Target2
mesh_6 = Mesh(move_2.Geometry)
merge = Merge(Data1=join_2, Data2=join)
Z_3 = UnitZ(Factor=-0.01)
show = Show(G=mesh_6)
spc = SolidPointCollide(Points=demesh.Vertices, Solid=mesh_4, Interior=False, Unidirectional=True, Strength=Slider(10, range=0..10))
load = Load(Point=demesh.Vertices, ForceVector=Z_3)
crv_6 = Curve(merge)
rod = Rod(Polyline=crv_6, LengthFactor=1, AngleFactor=1, AxialStrength=10, BendStrength=1)
diamond_panels = DiamondPanels(Surface=stream_gate.Target2, UDivisions=rh_in_udivisions, VDivisions=rh_in_vdivisions)  # -> DiamondPanels, TriPanels
quad_panels = QuadPanels(Surface=stream_gate.Target0, UDivisions=rh_in_udivisions, VDivisions=rh_in_vdivisions)
triangular_panels_a = TriangularPanelsA(Surface=stream_gate.Target1, UDivisions=rh_in_udivisions, VDivisions=rh_in_vdivisions)
merge_2 = Merge(Data1=rod, Data2=load, Data3=spc)
entwine = Entwine(Branch00=show, Branch01=merge_2, FlattenInputs=True)  # -> simplify(Result)
zombiesolver = ZombieSolver(GoalObjects=entwine, Threshold=1e-10, Tolerance=0.0001, MaxIterations=Slider(3000, range=0..10000))  # -> I, V, O
clean = CleanTree(RemoveNulls=True, RemoveInvalid=True, RemoveEmpty=False, Tree=zombiesolver.O)
deconstruct_brep = DeconstructBrep(Brep=srf)  # -> Faces, Edges, Vertices
objecttypesort = CSharpScript(geo=clean)  # -> out, Pt, Crv, Mesh, Brep, Srf; inputs geo: list of GeometryBase
# ---------- objecttypesort: C# ----------
    List<Rhino.Geometry.Point> Pts = new List<Rhino.Geometry.Point>();
    List<Curve> Crvs = new List<Curve>();
    List<Mesh> Meshes = new List<Mesh>();
    List<Brep> Breps = new List<Brep>();
    List<Brep> Srfs = new List<Brep>();


    foreach(GeometryBase x in geo){
      Rhino.DocObjects.ObjectType objectType = x.ObjectType;
      switch(objectType){
        case Rhino.DocObjects.ObjectType.Point: Pts.Add(x as Rhino.Geometry.Point);
          break;
        case Rhino.DocObjects.ObjectType.Curve: Crvs.Add(x as Curve);
          break;
        case Rhino.DocObjects.ObjectType.Mesh: Meshes.Add(x as Mesh);
          break;
        case Rhino.DocObjects.ObjectType.Brep:
          Brep brepObj = x as Brep;
          if(brepObj.IsSurface){
            Srfs.Add(brepObj);
          } else {
            Breps.Add(brepObj);
          }
          break;


      }
    }
    Pt = Pts;
    Crv = Crvs;
    Mesh = Meshes;
    Brep = Breps;
    Srf = Srfs;
# ---------- end objecttypesort ----------
mesh_7 = Mesh(objecttypesort.Mesh)
list_item = ListItem(List=deconstruct_brep.Edges, Index=0, Wrap=True)  # -> Item, Item1, Item2
curve = Curve(list_item.Item2)
curve_2 = Curve(list_item.Item)
bounding_box = BoundingBox(Content=[curve_2, curve], Plane=PlaneXY(0, 0, 0), UnionBox=True)  # -> Box, Box_2
surface = Surface([triangular_panels_a, quad_panels, diamond_panels.DiamondPanels, diamond_panels.TriPanels])
area_4 = Area(Geometry=bounding_box.Box)  # -> Area, Centroid
end_points = EndPoints(Curve=curve)  # -> Start, End
end_points_2 = EndPoints(Curve=curve_2)  # -> Start, End
line = Line(StartPoint=end_points_2.Start, EndPoint=end_points.End)
scale_nu = ScaleNU(Geometry=bounding_box.Box, Plane=area_4.Centroid, ScaleX=Slider(1.5, range=0..10), ScaleY=1, ScaleZ=1)  # -> Geometry, Transform
line_2 = Line(StartPoint=end_points_2.End, EndPoint=end_points.Start)
deconstruct_brep_2 = DeconstructBrep(Brep=scale_nu.Geometry)  # -> Faces, Edges, Vertices
list_item_2 = ListItem(List=deconstruct_brep_2.Faces, Index=0, Wrap=True)  # -> Item, Item1, Item2, Item3, Item4
join_curves = JoinCurves(Curves=[curve_2, curve, line_2, line], Preserve=False)
number_slider_2 = Slider(150, range=0..1000)

# ---- group: splitting
crv_7 = Curve(rebsrf)
project = Project(Geometry=crv_7, Plane=move.Geometry)  # -> Geometry, Transform
number_slider_3 = Slider(25, range=0..100)
reb_2 = RebuildCurve(Curve=project.Geometry, Count=Slider(100, range=0..100), Tangents=False)
neg = Negative(Value=number_slider_3)
offset = OffsetCurve(Curve=reb_2, Distance=Slider(0.5, range=0..1), Corners=1)
Z_4 = UnitZ(Factor=[neg, number_slider_3])
extr = Extrude(Base=offset, Direction=Z_4)  # -> flatten(Extrusion)
join_3 = BrepJoin(Breps=extr)  # -> Breps, Closed
cap = CapHoles(Brep=join_3.Breps)
cap_2 = CapHoles(Brep=extr)
srf_2 = Surface(surface)
splitmul = SplitBrepMultiple(Brep=flatten(srf_2), Cutters=cap)  # -> flatten(Result)
shapein = ShapeInBrep(Brep=cap_2, Shape=flatten(splitmul))
larger_2 = LargerThan(FirstNumber=shapein, SecondNumber="1")  # -> LargerThan, OrEqualTo
number_slider_4 = Slider(50, range=0..100)
cull = CullPattern(List=splitmul, CullPattern=invert(larger_2.LargerThan))
pt = ConstructPoint(XCoordinate=expr("-x", number_slider_4), YCoordinate=expr("-x", number_slider_4), ZCoordinate=0)
rectangle = Rectangle(Plane=pt, XSize=number_slider_2, YSize=number_slider_2, Radius=0)  # -> Rectangle, Length
Z_5 = UnitZ(Factor=Slider(0.5, range=0..1))
move_3 = Move(Geometry=rectangle.Rectangle, Motion=Z_5)  # -> Geometry, Transform
neg_2 = Negative(Value=Slider(5, range=0..10))
Z_6 = UnitZ(Factor=neg_2)
extr_2 = Extrude(Base=move_3.Geometry, Direction=Z_6)
cap_3 = CapHoles(Brep=extr_2)
trim = TrimSolid(Shape=cull, Cutters=cap_3)
area_5 = Area(Geometry=move_3.Geometry)  # -> Area, Centroid
pdecon_4 = Deconstruct(Point=area_5.Centroid)  # -> XComponent, YComponent, ZComponent
area_6 = Area(Geometry=trim)  # -> Area, Centroid
pdecon_5 = Deconstruct(Point=area_6.Centroid)  # -> XComponent, YComponent, ZComponent
panel = Panel("0")
larger_3 = LargerThan(FirstNumber=pdecon_5.ZComponent, SecondNumber=pdecon_4.ZComponent)  # -> LargerThan, OrEqualTo
dispatch_2 = Dispatch(List=trim, DispatchPattern=larger_3.LargerThan)  # -> ListA, ListB

# ----
crv_8 = Curve(objecttypesort.Crv)
join_4 = JoinCurves(Curves=crv_8, Preserve=False)
clean_2 = CleanTree(RemoveNulls=True, RemoveInvalid=True, RemoveEmpty=True, Tree=join_4)
bbox_3 = BoundingBox(Content=mesh_2, Plane=PlaneXY(0, 0, 0))  # -> Box, Box_2
surface_2 = Surface(list_item_2.Item4)
crv_9 = Curve(clean_2)
trim_2 = TrimWithBrep(Curve=crv_9, Brep=bbox_3.Box)  # -> Inside, Outside
crv_10 = Curve(flatten(trim_2.Inside))
end = EndPoints(Curve=crv_10)  # -> Start, End
rectangle_2 = Rectangle(Plane=PlaneXY(0, 0, 0), XSize="0.05", YSize=".08", Radius=0)  # -> Rectangle, Length
surface_3 = Surface(surface_2)
pframe = PerpFrame(Curve=reparameterize(crv_10), Parameter="0")
pln = Plane(rectangle_2.Rectangle)
settings_custom = SettingsCustom(
    StitchSeams=True,
    SimplePlanes=False,
    Refine=True,
    MinCount=16,
    MaxCount=400,
    AspectRatio=20,
    MaxDistance=0,
    MaxAngle=20,
    MinEdge="0.5",
    MaxEdge="0.5")
reb_3 = RebuildCurve(Curve=crv_10, Degree="3", Count=Slider(29, range=0..100), Tangents=False)
graft = GraftTree(Tree=reb_3, IncludeEmptyLists=True, IncludeNullItems=True)
orient = Orient(Geometry=graft(rectangle_2.Rectangle), Source=pln, Target=pframe)  # -> graft(Geometry), Transform
mesh_brep = MeshBrep(Brep=surface_3, Settings=settings_custom)
swp1 = Sweep1(Rail=graft, Sections=orient.Geometry, Miter=1)
mesh_8 = Mesh(mesh_brep)
len = Length(Curve=reb_3)
mesh_9 = Mesh(mesh_8)
demesh_2 = DeconstructMesh(Mesh=mesh_9)  # -> Vertices, Faces, Colours, Normals
mesh_colours = MeshColours(Mesh=swp1, Colours=ColourSwatch(SwatchColor=RGB(103, 11, 12)))
sort_3 = SortList(Keys=reb_3, ValuesA=len)  # -> Keys, ValuesA
bnd = Bounds(Numbers=demesh_2.Vertices)
mesh_10 = Mesh(flatten(dispatch_2.ListA))
srf_3 = Surface(flatten(dispatch_2.ListA))
remap = RemapNumbers(Value=demesh_2.Vertices, Source=bnd, Target=Domain(0, 1))  # -> Mapped, Clipped
item_4 = ListItem(List=reverse(sort_3.Keys), Index=0, Wrap=True)
item_5 = ListItem(List=sort_3.Keys, Index=0, Wrap=True)
lng = ListLength(List=reb_3)
graph = GraphMapper(
    remap.Mapped,
    x0=0,
    x1=1,
    y0=0,
    y1=1,
    amplitude=0.218028605,
    container_name="Perlin",
    decay=1,
    frequency=0.03698211908,
    x_offset=0.5846650004,
    y_offset=0.4053633809)
gradient = Gradient(LowerLimit="0", UpperLimit="1", Parameter=graph, stops=[0.28: RGB(212, 255, 38), 0.945: RGB(255, 255, 255)])
crv_11 = Curve(reb)
offset_2 = OffsetCurve(Curve=crv_11, Distance=Slider(8, range=0..10), Corners=1)
no_of_divisions = Panel(rh_in_paneltypenumber)
conmesh = ConstructMesh(Vertices=demesh_2.Vertices, Faces=demesh_2.Faces, Colours=gradient)
graft_tree = GraftTree(Tree=mesh_10, IncludeEmptyLists=True, IncludeNullItems=True)
clean_3 = CleanTree(RemoveNulls=True, RemoveInvalid=True, RemoveEmpty=False, Tree=srf_3)
stream_filter = StreamFilter(Gate=rh_in_showwireframe, Stream1=srf_3)
stream_filter_2 = StreamFilter(Gate=rh_in_showoriginalmesh, Stream1=get_geometry)
construct_domain = ConstructDomain(DomainStart=0, DomainEnd=1)
stream_filter_3 = StreamFilter(Gate=rh_in_showgridshell, Stream1=mesh_colours)

# ---- group: RH_OUT:member_number
data = Data(lng)

# ----
stream_filter_4 = StreamFilter(Gate=rh_in_showgridshellwireframe, Stream1=reb_3)
crv_12 = Curve(flatten([offset_2, crv_11]))

# ---- group: RH_OUT:shortest_member
data_2 = Data(item_5)

# ---- group: RH_OUT:longest_member
data_3 = Data(item_4)

# ----
debrep_4 = DeconstructBrep(Brep=clean_3)  # -> Faces, Edges, Vertices
loft = Loft(Curves=crv_12, Options={Adjust=False, Closed=False, LoftEnds=0, LoftSimp=0, LoftType=0, Rebuild=10, Refit=0.01})
number_slider_5 = Slider(10, range=0..100)
mblur = BlurMesh(Mesh=conmesh, Iterations=Slider(0, range=0..5))
area_7 = Area(Geometry=graft_tree)  # -> Area, Centroid
longestmember = Panel(data_3)
membernumber = Panel(data)
shortestmember = Panel(data_2)
area_8 = Area(Geometry=clean_3)  # -> Area, Centroid
join_5 = JoinCurves(Curves=debrep_4.Edges, Preserve=False)  # -> flatten(Curves)

# ---- group: RH_OUT:gridshell_curve
curve_3 = Curve(stream_filter_4)

# ---- group: RH_OUT:gridshell_mesh
mesh_11 = Mesh(stream_filter_3)

# ---- group: RH_OUT:originalMesh
mesh_12 = Mesh(stream_filter_2)

# ----
popgeo = PopulateGeometry(Geometry=loft, Count=100, Seed=1)
multiplication = Multiplication(A=number_slider_5, B=Slider(2, range=0..10))
mesh_13 = Mesh(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)
len_2 = Length(Curve=join_5)
entwine_2 = Entwine(Branch00=area_8.Area, Branch01=len_2, FlattenInputs=True)
construct_domain_2 = ConstructDomain(DomainStart=Slider(0, range=0..100), DomainEnd=Slider(433, range=0..1000))
flip = FlipMatrix(Data=entwine_2)
list_length = ListLength(List=flatten(area_7.Centroid))
range = Range(Domain=construct_domain, Steps=no_of_divisions)
divide_domain = DivideDomain(Domain=construct_domain, Count=no_of_divisions)
populate_geometry = PopulateGeometry(Geometry=loft, Count=number_slider_5, Seed=Slider(50, range=0..100))  # -> flatten(Population)
deconstruct_brep_3 = DeconstructBrep(Brep=stream_filter)  # -> Faces, Edges, Vertices
deconstruct = Deconstruct(Point=area_7.Centroid)  # -> XComponent, YComponent, ZComponent
panel_2 = Panel(flip)
plane = Plane(populate_geometry)
list_item_3 = ListItem(List=range, Index=0, Wrap=True)  # -> Item, Item1
random = Random(Range=construct_domain_2, Number=multiplication, Seed=Slider(52, range=0..100))
volume = Volume(Geometry=mesh_13)  # -> Volume, Centroid
construct_domain_3 = ConstructDomain(DomainStart=0, DomainEnd=1)
subtraction = Subtraction(A=list_item_3.Item1, B=list_item_3.Item)
bounds = Bounds(Numbers=flatten(deconstruct.YComponent))
project_2 = Project(Geometry=volume.Centroid, Plane=PlaneXY(0, 0, 0))  # -> Geometry, Transform
k_means = KMeansClustering(TrainingInputs=panel_2, OfClusters=rh_in_paneltypenumber, RandomSeed=5)  # -> Result, Likelihood, Centroids
lng_2 = ListLength(List=random)
stream_filter_5 = StreamFilter(Gate=boolean_toggle_3, Stream1=mblur)
deconstruct_domain = DeconstructDomain(Domain=construct_domain)  # -> Start, End
curve_4 = Curve(crv_11)
pt_2 = Point(project_2.Geometry)
random_2 = Random(Range=construct_domain_3, Number=list_length, Seed=2)  # -> graft(Random)
division = Division(A=subtraction, B="2")
addition = Addition(A=range, B=division)
bnd_2 = Bounds(Numbers=k_means.Result)
rotate_2 = Rotate(Geometry=plane, Angle=degrees(random), Plane=plane)  # -> Geometry, Transform
remap_numbers = RemapNumbers(Value=deconstruct.YComponent, Source=bounds, Target=construct_domain)  # -> Mapped, Clipped
last_index = LastIndex(List=addition)
remap_numbers_2 = RemapNumbers(Value=k_means.Result, Source=bnd_2, Target=construct_domain)  # -> graft(Mapped), Clipped
cull_index = CullIndex(List=addition, Indices=last_index, Wrap=True)
orient_2 = Orient(Geometry=mesh_13, Source=pt_2, Target=rotate_2.Geometry)  # -> Geometry, Transform
stream_filter_6 = StreamFilter(Gate=boolean_toggle, Stream1=curve_4)
gradient_2 = Gradient(
    LowerLimit=deconstruct_domain.Start,
    UpperLimit=deconstruct_domain.End,
    Parameter=cull_index,
    stops=[0.15: RGB(255, 130, 160), 0.85: RGB(220, 0, 40)])
gradient_3 = Gradient(
    LowerLimit=deconstruct_domain.Start,
    UpperLimit=deconstruct_domain.End,
    Parameter=cull_index,
    stops=[0: RGB(243, 57, 0), 0.1: RGB(236, 27, 60), 0.2: RGB(210, 0, 118), 0.3: RGB(103, 0, 120), 0.4: RGB(39, 72, 161), 0.5: RGB(1, 192, 229), 0.6: RGB(18, 178, 90), 0.7: RGB(79, 186, 8), 0.8: RGB(220, 237, 32), 0.9: RGB(247, 159, 20), 1: RGB(243, 57, 0)])
gradient_4 = Gradient(
    LowerLimit=deconstruct_domain.Start,
    UpperLimit=deconstruct_domain.End,
    Parameter=cull_index,
    stops=[0: RGB(234, 38, 0), 0.25: RGB(234, 126, 0), 0.5: RGB(254, 244, 84), 0.75: RGB(173, 203, 249), 1: RGB(75, 107, 169)])
random_3 = Random(Range=Domain(0.5, 1), Number=lng_2, Seed=2)
curve_boundary = Curve(stream_filter_6)
stream_filter_7 = StreamFilter(Gate=rh_in_panelgroupingtype, Stream0=random_2, Stream1=remap_numbers.Mapped, Stream2=remap_numbers_2.Mapped)
scale_2 = Scale(Geometry=orient_2.Geometry, Center=rotate_2.Geometry, Factor=random_3)  # -> simplify(graft(Geometry)), Transform
list_length_2 = ListLength(List=popgeo)
demesh_3 = DeconstructMesh(Mesh=scale_2.Geometry)  # -> simplify(Vertices), Faces, Colours, Normals
includes = Includes(Value=stream_filter_7, Domain=divide_domain)  # -> Includes, Deviation
pdecon_6 = Deconstruct(Point=demesh_3.Vertices)  # -> XComponent, YComponent, ZComponent
stream_filter_8 = StreamFilter(Gate=rh_in_colourtype, Stream0=gradient_4, Stream1=gradient_3, Stream2=gradient_2)
member_index = MemberIndex(Set=includes.Includes, Member=Toggle(True))  # -> Index, Count
bnd_3 = Bounds(Numbers=pdecon_6.ZComponent)
remap_2 = RemapNumbers(Value=pdecon_6.ZComponent, Source=bnd_3, Target=Domain(0, 1))  # -> Mapped, Clipped
gradient_5 = Gradient(
    LowerLimit=0,
    UpperLimit=1,
    Parameter=remap_2.Mapped,
    stops=[0: RGB(132, 196, 29), 0.359: RGB(105, 214, 130), 0.789: RGB(164, 219, 101)])
list_item_4 = ListItem(List=stream_filter_8, Index=member_index.Index, Wrap=True)  # -> simplify(Item)
mcol = MeshColours(Mesh=scale_2.Geometry, Colours=gradient_5)
mesh_14 = Mesh(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)
colours = Data(flatten(list_item_4))
create_set = CreateSet(List=colours)  # -> Set, Map
random_4 = Random(Range=Domain(0, 360), Number=list_length_2, Seed=Slider(42, range=0..100))
mesh_15 = Data(simplify(flatten(graft_tree)))
member_index_2 = MemberIndex(Set=colours, Member=create_set.Set)  # -> Index, Count
plane_2 = Plane(popgeo)
volume_2 = Volume(Geometry=mesh_14)  # -> Volume, Centroid
mblur_2 = BlurMesh(Mesh=mcol, Iterations=Slider(1, range=0..5))
project_3 = Project(Geometry=volume_2.Centroid, Plane=PlaneXY(0, 0, 0))  # -> Geometry, Transform
list_item_organised_meshes = ListItem(List=mesh_15, Index=member_index_2.Index, Wrap=True)
list_indices = ListIndices(List=create_set.Set)
pt_3 = Point(project_3.Geometry)
stream_filter_9 = StreamFilter(Gate=boolean_toggle_4, Stream1=mblur_2)
rotate_3 = Rotate(Geometry=plane_2, Angle=degrees(random_4), Plane=plane_2)  # -> Geometry, Transform
graft_tree_2 = GraftTree(Tree=list_indices, IncludeEmptyLists=True, IncludeNullItems=True)
area_9 = Area(Geometry=list_item_organised_meshes)  # -> Area, Centroid
orient_3 = Orient(Geometry=mesh_14, Source=pt_3, Target=rotate_3.Geometry)  # -> Geometry, Transform
lng_3 = ListLength(List=random_4)
x_plus_one = XPlusOne(NumberX=graft_tree_2)
random_5 = Random(Range=Domain(0.85, 1), Number=lng_3, Seed=2)
stream_filter_10 = StreamFilter(Gate=rh_in_paneltype, Stream0="Quad", Stream1="Triangular", Stream2="Diamond")
scale_3 = Scale(Geometry=orient_3.Geometry, Center=rotate_3.Geometry, Factor=random_5)  # -> Geometry, Transform
list_length_3 = ListLength(List=flatten(list_item_4))
c_script = CSharpScript(face="Arial", bold=Toggle(False), size=Slider(0.781, range=0..11), content=x_plus_one, pl=area_9.Centroid)  # -> out, A; inputs face: String, bold: Boolean, italics: Boolean, size: Double, content: String, pl: Plane
# ---------- c_script: C# usings ----------
using System.IO;
using System.Linq;
using System.Data;
using System.Drawing;
using System.Reflection;
using System.Windows.Forms;
using System.Xml;
using System.Xml.Linq;
using System.Runtime.InteropServices;

using Rhino.DocObjects;
using Rhino.Collections;
using GH_IO;
using GH_IO.Serialization;
# ---------- c_script: C# ----------
    if(size == 0)
      size = 1;

    if(!string.IsNullOrEmpty(face) && size > 0 && !string.IsNullOrEmpty(content) &&
      pl.IsValid)
    {
      using (var doc = Rhino.RhinoDoc.CreateHeadless(null))
      {
        var te = doc.Objects.AddText(content, pl, size, face, bold, italics);
        var txt = doc.Objects.Find(te) as Rhino.DocObjects.TextObject;

        if(txt != null)
        {
          var tt = txt.Geometry as Rhino.Geometry.TextEntity;
          A = tt.Explode();
        }
      }
    }
# ---------- end c_script ----------
stream_filter_11 = StreamFilter(Gate=rh_in_colourtype, Stream0="scattered", Stream1="x-axis", Stream2="k-means")
stream_filter_12 = StreamFilter(Gate=rh_in_colourtype, Stream0="heat", Stream1="rainbow", Stream2="red")
area_10 = Area(Geometry=srf)  # -> Area, Centroid
mesh_colours_2 = MeshColours(Mesh=scale_3.Geometry, Colours=ColourSwatch(SwatchColor=RGB(255, 255, 255)))
stream_filter_13 = StreamFilter(Gate=boolean_toggle_2, Stream1=mesh_colours_2)
stream_filter_14 = StreamFilter(Gate=rh_in_showgroupnumbers, Stream1=c_script.A)
offset_mesh = OffsetMesh(Mesh=graft_tree, Distance=Slider(0.2, range=0..1), BothSides=0, CreateSolid=True)
integer = Integer(list_length_3)
integer_2 = Integer(area_10.Area)
integer_3 = Integer(rh_in_paneltypenumber)
custom_preview = CustomPreview(Geometry=offset_mesh, Material=list_item_4)
c_script_2 = CSharpScript(mesh=simplify(offset_mesh), color=list_item_4)  # -> out, A; inputs mesh: Mesh, color: Color
# ---------- c_script_2: C# ----------
    var c = color.R + "," + color.G + "," + color.B;
    mesh.SetUserString("color", c);
    A = mesh;
# ---------- end c_script_2 ----------
stream_filter_15 = StreamFilter(Gate=rh_in_showcolour, Stream1=c_script_2.A)

# ---- group: RH_OUT:panel_type
data_4 = Data(flatten(stream_filter_10))

# ---- group: RH_OUT:colour_gradient
data_5 = Data(flatten(stream_filter_12))

# ---- group: RH_OUT:panel_type_number
data_6 = Data(flatten(integer_3))

# ---- group: RH_OUT:grouping_type
data_7 = Data(flatten(stream_filter_11))

# ---- group: RH_OUT:panel_number
data_8 = Data(flatten(integer))

# ---- group: RH_OUT:sky_visibility_area
data_9 = Data(flatten(integer_2))

# ----
colour_gradient = Panel(data_5)
grouping_type = Panel(data_7)
# DATA
# DATA OUTPUT
sky_visibility_area = Panel(data_9)
panel_type = Panel(data_4)
panel_number = Panel(data_8)

# ---- group: RH_OUT:terrain
mesh_16 = Mesh(flatten(stream_filter_5))

# ----
panel_type_number = Panel(data_6)

# ---- group: RH_OUT:curve_boundary
curve_5 = Curve(flatten(curve_boundary))

# ---- group: RH_OUT:people
geometry_people = Geometry(flatten(stream_filter_13))

# ---- group: RH_OUT:trees
geometry_trees = Geometry(flatten(stream_filter_9))

# ---- group: RH_OUT:colour
# GEOMETRY OUTPUT
mesh_17 = Mesh(stream_filter_15)

# ---- group: RH_OUT:panel_group_numbers
curve_6 = Curve(stream_filter_14)

# ---- group: RH_OUT:edge_curves
curve_7 = Curve(flatten(deconstruct_brep_3.Edges))
